# Grasshopper definition Working Algorithm.gh (Grasshopper 1.0.7)
# plug-ins: Firefly_X, Weaverbird, Bifocals, Kangaroo2 Components, Moonlight, eleFront, Heliotrope, Human

boolean_toggle = BooleanToggle(True)

# ----
# Sound and Time
number_slider = Slider(0.02, range=0..0.1)
trigger = Trigger(Interval=10, TimerInterval=10, Target=sound_capture)
sound_capture = SoundCapture(TimePeriod=number_slider, StartStopSoundCapture=Toggle(True))  # -> WavePressureSamplesFromLeftChannel, WavePressureSamplesFromRightChannel, Volume
data_recorder = DataRecorder(sound_capture.Volume, DataLimit=1, RecordData=True)
panel = Panel(data_recorder)

# ----
# Catmull Smoothness
number_slider_2 = Slider(3, range=0..10)
geometry = Geometry()
mesh = Mesh(geometry)
weaverbird_s_catmull_clark_subdivision = WeaverbirdsCatmullClarkSubdivision(MeshCurves=mesh, Level=number_slider_2, SmoothNakedEdges=1)

mesh_2 = Mesh()
# Extras
number_slider_3 = Slider(0.208, range=0..10)
weaverbird_s_picture_frame = WeaverbirdsPictureFrame(MeshPolylines=mesh_2, Distance=Slider(43, range=0..50), InsetType=0)
weaverbird_s_mesh_thicken = WeaverbirdsMeshThicken(MeshCurves=weaverbird_s_picture_frame, Distance=Slider(1, range=0..10), OffsetType=0)
weaverbird_s_catmull_clark_subdivision_2 = WeaverbirdsCatmullClarkSubdivision(MeshCurves=weaverbird_s_mesh_thicken, Level=number_slider_3, SmoothNakedEdges=1)

# ----
# More Smoothness
number_slider_4 = Slider(2, range=0..10)
geometry_2 = Geometry()
smooth = Smooth(M=geometry_2, Strength=number_slider_4)

moonlight = Moonlight(Mode=Toggle(True))
multiplication = Multiplication(A=data_recorder, B=Slider(0.106, range=0..40))

curve = Curve(<curve referenced from the Rhino model>)
curve_2 = Curve(<curve referenced from the Rhino model>)
# Construction Geometry
curve_3 = Curve(<curve referenced from the Rhino model>)
area = Area(Geometry=curve_2)  # -> Area, Centroid
area_2 = Area(Geometry=curve_3)  # -> Area, Centroid
area_3 = Area(Geometry=curve)  # -> Area, Centroid
scale = Scale(Geometry=curve, Center=area_3.Centroid, Factor=multiplication)  # -> Geometry, Transform
scale_2 = Scale(Geometry=curve_2, Center=area.Centroid, Factor=multiplication)  # -> Geometry, Transform
scale_3 = Scale(Geometry=curve_3, Center=area_2.Centroid, Factor=multiplication)  # -> Geometry, Transform

divide_curve = DivideCurve(Curve=scale.Geometry, Count=Slider(19, range=0..100), Kinks=False)  # -> Points, Tangents, Parameters
divide_curve_2 = DivideCurve(Curve=scale_2.Geometry, Count=Slider(40, range=0..100), Kinks=False)  # -> Points, Tangents, Parameters
# Scale, Divide and Move
divide_curve_3 = DivideCurve(Curve=scale_3.Geometry, Count=Slider(22, range=0..100), Kinks=False)  # -> Points, Tangents, Parameters
move = Move(Geometry=divide_curve.Points, Motion=area_3.Centroid)  # -> Geometry, Transform
move_2 = Move(Geometry=divide_curve_2.Points, Motion=area.Centroid)  # -> Geometry, Transform
move_3 = Move(Geometry=divide_curve_3.Points, Motion=area_2.Centroid)  # -> Geometry, Transform
polyline = PolyLine(Vertices=move.Geometry, Closed=Toggle(True))
polyline_2 = PolyLine(Vertices=move_2.Geometry, Closed=Toggle(True))
polyline_3 = PolyLine(Vertices=move_3.Geometry, Closed=Toggle(True))
loft = Loft(
    Curves=[polyline_3, polyline_2, polyline],
    Options={Adjust=False, Closed=False, LoftEnds=0, LoftSimp=0, LoftType=0, Rebuild=10, Refit=0.01})

button = Button()
now = JulianDayCurrentTime(ContinuousUpdate=button)
panel_2 = Panel(now)
ef_att = EleFrontAttributes(Layer=now)  # -> Attributes, Keys, Values, Name, Layer, ColourSource, DisplayColour, MaterialSource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
# Baking
bake = BakeObjects(Geometry=loft, Attributes=ef_att.Attributes, BakeName=now, Bake=button, createGroups=False)  # -> Message, Guids

# ----
# Sorting
geo = Geometry([<curve referenced from the Rhino model> x5, <brep referenced from the Rhino model> x5])
series = Series(Start=Slider(19, range=0..500), Step=Slider(6, range=0..500), Count=Slider(5, range=0..100))
panel_3 = Panel(series)
X = UnitX(Factor=panel_3)
move_4 = Move(Geometry=geo, Motion=X)  # -> Geometry, Transform

geo_2 = Geometry(move_4.Geometry)
sortbytype = SortObjectsByType(RhinoObjects=geo_2)  # -> Points, Curves, Surfaces, Breps, Meshes, TextObjects, HatchObjects, LightObjects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
brep = Brep(sortbytype.Breps)
